# Grasshopper definition DLA_Allcode.gh (Grasshopper 1.0.7)
# plug-ins: gHowl

# ----
# Based on the tutorial and script from: https://yucchen.com/opencv-to-grasshopper/
# Substitute IP with your local IP
# comments: [3] attractor point, comes out of the geometrical center of the face detection rectangle
local_ip = Panel("192.168.0.100")
# Port must remain the same
port = Panel("5000")
# PyCharm/OpenCV and Grasshopper communication.
udp = UDPReceiver(Address=local_ip, Port=port, Pattern=0)  # -> Info, Data
panel = Panel(udp.Data)
split = TextSplit(Text=udp.Data, Separators=",")
item = ListItem(List=split, Index=split, Wrap=True)  # -> Item, Item1, Item2, Item3, Item4
panel_2 = Panel(split)
pt = ConstructPoint(XCoordinate=item.Item, YCoordinate=item.Item1, ZCoordinate=item.Item2)
panel_3 = Panel(pt)
list_item = ListItem(List=pt, Index="4", Wrap=True)
list_item_2 = ListItem(List=pt, Index="3", Wrap=True)

# ---- group: 3d field_how to integrate?
pt_2 = Point(Point(4.470539186, 4.866823908, 3.93651149))
python = GhPythonScript(z=pt_2)  # -> out, b, a, c
# ---------- python: Python ----------
import rhinoscriptsyntax as rs
import Rhino.Geometry as rg
import math

def rotT(x,y,z,theta):                                                       # Function for rotate angl. ##https://www.khanacademy.org/math/linear-algebra/matrix-transformations/lin-trans-examples/v/linear-transformation-examples-rotations-in-r2
    xr = x
    yr = y*math.cos(theta)-z*math.sin(theta) 
    zr = z*math.cos(theta)+y*math.sin(theta) 
    return xr, yr, zr

def grid (nPoints):
    grid = []
    for x in range(0, nPoints):
        for y in range(0, nPoints):
            for z in range(0, nPoints):
                grid.append(rg.Point3f(x, y, z))
    
    return grid

def distance(iAttractor, myPoints):
    distVec = []
    for point in myPoints:
        distVec.append(rg.Point3d.DistanceTo(iAttractor, point))
    return distVec

gridA = grid(10)

iAttractor = rs.coerce3dpoint(z)
#iAttractor.X = (iAttractor.X/640)*20
#iAttractor.Y = (iAttractor.Y/480)*20
mySphere = rg.Sphere(iAttractor, 0.5)

distVec = distance(iAttractor, gridA)

xP = iAttractor.X
yP = iAttractor.Y
zP = iAttractor.Z

energy = (xP*xP+yP*yP+zP*zP)/3
xPn = xP/(math.sqrt(energy)) #next step: 1/distance.sqr (gravity and eletric field)  # normalize vector to unitary energy
yPn = yP/(math.sqrt(energy))
zPn = zP/(math.sqrt(energy))

iAttractor90X, iAttractor90Y, iAttractor90Z= rotT(xPn, yPn, zPn, 90)
iAttractorm90X, iAttractorm90Y, iAttractorm90Z= rotT(xPn, yPn, zPn, -90)
iAttractor90 = rg.Point3f(iAttractor90X, iAttractor90Y, iAttractor90Z)
iAttractorm90 = rg.Point3f(iAttractorm90X, iAttractorm90Y, iAttractorm90Z)

for index in range(0, len(gridA)):
    if distVec[index] < 2:
        if gridA[index].Y > gridA[index].X: 
            gridA[index] = gridA[index]+iAttractor90
        else:    
            gridA[index] = gridA[index]+iAttractorm90
    
    
a = gridA
b = mySphere
# ---------- end python ----------
point = Point(python.a)
panel_4 = Panel(python.c)

# ----
reset = Button()
initial_particles = Point(Point(43.19649614, 45.685206, 38.64792427))
free_particle_count = Slider(386, range=0..500)
subiterations = Slider(1, range=0..400)
trigger = Trigger(Interval=1, TimerInterval=5, Target=ghpython_script_2)  # disabled

# ---- group: perlin flowfield class
number_slider = Slider(5, range=0..10)
number_slider_2 = Slider(10, range=0..10)
point_2 = Point(Point(13.76552076, 14.42115427, 7.524416473))
number_slider_3 = Slider(10, range=0..10)
vector = Vector(point_2)
ghpython_script = GhPythonScript(ffSize=Slider(34, range=0..100), ffRes=Slider(3, range=1..10), ffScaleP=Slider(0.062, range=0..1), VEC=vector)  # -> out, a; inputs ffSize: Int32, ffRes: Int32, VEC: Vector3d
# ---------- ghpython_script: Python ----------
__author__ = "Mengxi"
__version__ = "2021.02.06"

import Rhino.Geometry as rg
import rhinoscriptsyntax as rs
import perlin as p


sn=p.SimplexNoise()




class FlowField:
    
    def __init__(self, size, res, scalePerlin):
        self.size=size
        self.scaleP=scalePerlin
        self.res=res
        self.pointsPerSide= int(size/res)
        self.grid=self.createGrid()
            
            
            
    def createGrid(self):
        L=[]
        for i in range(self.pointsPerSide):
            L.append([])
            for j in range(self.pointsPerSide):
                L[i].append([])
                for k in range(self.pointsPerSide):
                    L[i][j].append([])
                    point=[i*self.res, j*self.res, k*self.res]
                    perVal= sn.noise3(i*self.scaleP, j*self.scaleP, k*self.scaleP)
                    xVec=[self.res,0,0]
                    rotV=rs.VectorRotate(xVec, 360*perVal, [0,0,1])
                    endV=rs.VectorCreate(point,rotV)
                    L[i][j][k]=rotV
        return L
    
    
    def lookUp(self, vec):
        x=int(vec[0]/self.res)
        y=int(vec[1]/self.res)
        z=int(vec[2]/self.res)
        return self.grid[x][y][z]
        
    def drawFirstLayer(self):
        
        layer=[]
        for i in range(self.pointsPerSide):
            for j in range(self.pointsPerSide):
                point=[i*self.res, j*self.res, 0]
                endV=rs.VectorCreate(point,self.lookUp(point))
                layer.append(rs.AddLine(point, endV))
        return layer


ff=FlowField(ffSize, ffRes, ffScaleP)
a=ff.drawFirstLayer()
# ---------- end ghpython_script ----------
pylist = GhPythonScript(x=ghpython_script.a)  # -> out, a
# ---------- pylist: Python ----------
import collections
xIsList = isinstance(x, collections.Iterable)


if (xIsList):
    a=x
    
else:
    a=[x]
# ---------- end pylist ----------
pylist_2 = GhPythonScript(x=pylist.a)  # -> out, a; same code as pylist
pylist_3 = GhPythonScript(x=pylist_2.a)  # -> out, a; same code as pylist

# ----
ghpython_script_2 = GhPythonScript(
    iReset=reset,
    iInitialParticles=initial_particles,
    iFreeParticlesCount=free_particle_count,
    iSubiterations=subiterations,
    scalePerlin=Slider(0.0107, range=0..0.1))  # -> out, Particles, FreeParticles, Branches; inputs iReset: Boolean, iInitialParticles: list of Point3d, iFreeParticlesCount: Int32, iSubiterations: Int32, iExternalVevtor: Vector3d
# ---------- ghpython_script_2: Python ----------
import Rhino.Geometry as rg
import Grasshopper.Kernel as gk
import Grasshopper.Kernel.Types as gkt
import random as rd
import math
import rhinoscriptsyntax as rs
import perlin as p

sn=p.SimplexNoise()
boundarySize = 200


class Util:
    def __init__(self):
        pass

    @staticmethod
    def RandomUnitVector():
        # generate a random UnitVector
        # self.lock.acquire()
        theta = 2.0 * math.pi * rd.random()
        phi = math.acos(2.0 * rd.random() - 1.0)
        return rg.Vector3d(math.sin(phi) * math.cos(theta), math.sin(phi) * math.sin(theta), math.cos(phi))
        # self.lock.release()

    @staticmethod
    def RandomUnitVectorUpperHemisphere():
        # self.lock.acquire()
        theta = 2.0 * math.pi * rd.random()
        phi = math.acos(2.0 * rd.random() - 1.0)
        return rg.Vector3d(math.sin(phi) * math.cos(theta), math.sin(phi) * math.sin(theta), abs(math.cos(phi)))
        # self.lock.release()


class FreeParticle:
    def __init__(self, environmentBoundary, particleRadius):
        self.Position = rg.Point3d.Origin + Util.RandomUnitVectorUpperHemisphere() * environmentBoundary
        self.Velocity = Util.RandomUnitVector() * particleRadius


class DlaSystem:
    def __init__(self, initialParticles, freeParticlesCount):
        self.FreeparticlesCount = freeParticlesCount
        self.Particles = initialParticles
        #self.ff=FlowField(boundarySize,10,scalePerlin)
        self.Branches = []
        self.clusterReach = 0.0
        self.particleRadius = 3.0
        self.environmentBoundary = 0.0
        for p in self.Particles:
            d = p.DistanceTo(rg.Point3d.Origin)
            if d > self.clusterReach:
                self.clusterReach = d
        self.UpdateEnvironmentBoundary()
        self.FreeParticles = []
        self.fParticle = FreeParticle(self.environmentBoundary, self.particleRadius)
        for i in range(self.FreeparticlesCount):
            self.FreeParticles.append(self.fParticle)
        self.rTree=rg.RTree()
        for i in range (len(self.Particles)):
            self.rTree.Insert(self.Particles[i],i)

    def UpdateEnvironmentBoundary(self):
        self.environmentBoundary = self.clusterReach * 1.0
        if self.environmentBoundary < self.particleRadius * 1.0:
            self.environmentBoundary = self.particleRadius * 1.0

        
    def Iterate(self):
        for i in range(len(self.FreeParticles)):
            freeParticle = self.FreeParticles[i]
            # apply random force to the particle
            #v= self.ff.lookUp(freeParticle.Velocity)
            randomForce = Util.RandomUnitVector() * self.particleRadius# + v/5    +iExternalVevtor
            freeParticle.Velocity += randomForce

            if freeParticle.Velocity.Length > self.particleRadius:
                freeParticle.Velocity *= self.particleRadius / freeParticle.Velocity.Length
            freeParticle.Position += freeParticle.Velocity#+iExternalVevtor
            self.ProcessBoundary(freeParticle)
            # if the particle wanders out of range, respawn it
            if freeParticle.Position.DistanceTo(rg.Point3d.Origin) > self.environmentBoundary and freeParticle.Position.Z < 0.0:
                self.FreeParticles[i] = FreeParticle(self.environmentBoundary, self.particleRadius)
                continue

            # Otherwise check if the free Particle collide with the cluster
            collidedParticle = rg.Point3d.Unset
            for particle in self.Particles:
                if freeParticle.Position.DistanceTo(particle) <2.0 * self.particleRadius:
                    collidedParticle = particle

            def SearchCallback(sender, args):
                collidedParticle=self.Particles[args.Id]
                args.Cancel=True
            self.rTree.Search(rg.Sphere(freeParticle.Position, 2.0*self.particleRadius), SearchCallback)

            # if a collision has been found
            if collidedParticle.IsValid:
                self.Particles.append(freeParticle.Position)
                #self.Branches.append(rg.Line(freeParticle.Position, collidedParticle))
                self.Branches.append(rg.Line(collidedParticle,freeParticle.Position))
                self.FreeParticles[i] = FreeParticle(self.environmentBoundary, self.particleRadius)
                distanceToOrigin = freeParticle.Position.DistanceTo(rg.Point3d.Origin)
                if self.clusterReach < distanceToOrigin:
                    self.clusterReach = distanceToOrigin

    def ProcessBoundary(self, particle):
        if particle.Position.X<0:
            particle.Position.X=boundarySize
        elif particle.Position.X>boundarySize:
            particle.Position.X=0
        
        if particle.Position.Y<0:
            particle.Position.Y=boundarySize
        elif particle.Position.Y>boundarySize:
            particle.Position.Y=0

        if particle.Position.Z<0:
            particle.Position.Z=boundarySize
        elif particle.Position.Z>boundarySize:
            particle.Position.Z=0
        
        self.UpdateEnvironmentBoundary()


class FlowField:
    def __init__(self, size, res, scalePerlin):
        self.size=size
        self.scaleP=scalePerlin
        self.res=res
        self.pointsPerSide= int(size/res)
        self.grid=self.createGrid()
    def createGrid(self):
        L=[]
        for i in range(self.pointsPerSide):
            L.append([])
            for j in range(self.pointsPerSide):
                L[i].append([])
                for k in range(self.pointsPerSide):
                    L[i][j].append([])
                    point=[i*self.res, j*self.res, k*self.res]
                    perVal= sn.noise3(i*self.scaleP, j*self.scaleP, k*self.scaleP)
                    xVec=[self.res,0,0]
                    rotV=rs.VectorRotate(xVec, 360*perVal, [0,0,1])
                    endV=rs.VectorCreate(point,rotV)
                    L[i][j][k]=rotV
        return L
    def lookUp(self, vec):
        x=int(vec[0]/self.res)
        y=int(vec[1]/self.res)
        z=int(vec[2]/self.res)
        return self.grid[x][y][z]
        
    def drawFirstLayer(self):
        
        layer=[]
        for i in range(self.pointsPerSide):
            for j in range(self.pointsPerSide):
                point=[i*self.res, j*self.res, 0]
                endV=rs.VectorCreate(point,self.lookUp(point))
                layer.append(rs.AddLine(point, endV))
        return layer

# main program

if iReset or "myDlaSystem" not in globals():
    InitialParticles = iInitialParticles
    InitialBranches = []
    FreeParticlesCount = iFreeParticlesCount
    myDlaSystem = DlaSystem(InitialParticles, FreeParticlesCount)


else:
    for i in range(iSubiterations):
        myDlaSystem.Iterate()




Particles = []
for particle in myDlaSystem.Particles:
    Particles.append(gkt.GH_Point(particle))

Branches = []
for line in myDlaSystem.Branches:
    Branches.append(gkt.GH_Line(line))

FreeParticles = []
for freeParticle in myDlaSystem.FreeParticles:
    FreeParticles.append(gkt.GH_Point(freeParticle.Position))
# ---------- end ghpython_script_2 ----------
geometry = Geometry([Line((-80.28820437, 48.21215285, 29.28160665), (-79.50181049, 46.73254424, 28.89739265)), Line((-80.28820437, 48.21215285, 29.28160665), (-82.01094017, 49.02500165, 30.05481138)), Line((-79.50181049, 46.73254424, 28.89739265), (-79.03724951, 46.00279663, 30.73420631)), Line((-80.28820437, 48.21215285, 29.28160665), (-79.65188945, 50.30469904, 30.16894808)), Line((-79.03724951, 46.00279663, 30.73420631), (-78.41523154, 44.42601958, 30.72262003)), Line((-82.01094017, 49.02500165, 30.05481138), (-81.69100404, 50.87479711, 30.00998501))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])  # disabled
point_3 = Point(Point(-80.28820437, 48.21215285, 29.28160665))  # disabled
pt_3 = Point(ghpython_script_2.Particles)
pt_4 = Point(ghpython_script_2.FreeParticles)
line = Line(ghpython_script_2.Branches)
point_4 = Point(Point(205.4610446, -28.43080121, 145.5905352))
trigger_2 = Trigger(Interval=10, TimerInterval=10, Target=ghpython_script_3)  # disabled
point_5 = Point(point_4)
# to use perlin function, download perlin.py, copy file to C:\Users\MAX'S MONSTER\AppData\Roaming\McNeel\Rhinoceros\7.0\scripts
rectangle = Rectangle({Plane=PlaneXY(100, 100, 0), Size=Domain2(u=-100..100, v=-100..100)})
box_rectangle = BoxRectangle(Rectangle=rectangle, Height=Slider(200, range=0..1000))
brep_edges = BrepEdges(Brep=box_rectangle)  # -> Naked, Interior, NonManifold

# ---- group: DYNAMIC_POINT
# DYNAMIC POINT TO VECTOR
wip_smoothing = Slider(50, range=0..100)
ghpython_script_3 = GhPythonScript(iReset=Button(), iPosition=point_5, iGlitchTreshold=wip_smoothing)  # -> out, oLastPlace, oCurrPlace, oList, oVector; inputs iReset: Boolean, iPosition: Point3d
# ---------- ghpython_script_3: Python ----------
__author__ = "GSK"
__version__ = "2021.01.11"

import Rhino.Geometry as rg
import math
import random
import time
#from time import sleep


#__INIT__


currPos = iPosition
glichTresh = iGlitchTreshold
positions = []
#lastPos = rg.Point3d(0.0,0.0,0.0) #initial position may be middle of the frame


class GetVector:
    def __init__(self, pos, delay):
        
        self.CurrPosition = rg.Point3d(pos.X,pos.Y,pos.Z)
        self.LastPosition = rg.Point3d(0.0,0.0,0.0)
        self.HistoryOfPoints = []
        self.HistoryOfPoints.append(self.CurrPosition)
        self.Vector = rg.Vector3d(0.0,0.0,0.0)
        
        self.Delay = delay #magic happends here
        
    def Update(self,pos):
        
        #pos = Smooth(pos,tresh)
        
        self.Vector = rg.Vector3d(self.CurrPosition - self.LastPosition)
        self.LastPosition = self.CurrPosition
        self.CurrPosition = pos 
        
        self.HistoryOfPoints.append(self.CurrPosition)
        time.sleep(self.Delay)
        
        if len(self.HistoryOfPoints)>10:
            del self.HistoryOfPoints[0]
            
        return self.Vector
        return Smooth(self.Vector,glichTresh)
        
    def Smooth(self,val,tresh):
        pass
        av = mean(self.HistoryOfPoints)
        
        
        if abs(val - av) > tresh:
            val = av
        
        return val



#__MAIN__

if iReset or not("a" in globals()):
    a = GetVector(currPos,0.1)
else:
    vec = a.Update(currPos)

#__smoothing_functions__
#if (abs(thisValue - last10av) > glitchTreshold):
#    thisValue = last10av


#a(i+1) = tiny*data(i+1) + (1.0-tiny)*a(i)


#__OUT__

oList = positions
oLastPlace = a.LastPosition
oCurrPlace = a.CurrPosition
oVector = vec


###

"""

rawVectors = []

def changeRawVectors():
    rawVectors.append((time.time(), value))
    
    

positions.append(currPos)
time.sleep(0.5)
lastPos = currPos


self.History.append(self.Position)
            
            #______removing older parts
            if len(self.History)>50:
                del self.History[0]
                
                
def GetVector(pos):
    positions.append(pos)
    time.sleep(0.1)


vec = rg.Vector3d(currPos-lastPos) 



"""
# ---------- end ghpython_script_3 ----------
colour_swatch = ColourSwatch(SwatchColor=RGB(0, 219, 208))

geometry_2 = Geometry(ghpython_script_3.oLastPlace)
geometry_3 = Geometry(ghpython_script_3.oCurrPlace)
vector_display_ex = VectorDisplayEx(Point=geometry_2, Vector=ghpython_script_3.oVector, Colour=colour_swatch, Width=2)

custom_preview = CustomPreview(Geometry=[geometry_2, geometry_3], Material=colour_swatch)

# ----
vector_2 = Vector(ghpython_script_3.oVector)
division = Division(A=vector_2, B="10")

# ---- group: 3d_dla with field
free_particle_count_2 = Slider(500, range=0..500)
subiterations_2 = Slider(1, range=0..400)
reset_2 = Button()
trigger_3 = Trigger(Interval=1, TimerInterval=5, Target=ghpython_script_4)  # disabled
initial_particles_2 = Point(Point(104.3297172, 105.2707855, 100.2386507))
ghpython_script_4 = GhPythonScript(
    iReset=reset_2,
    iInitialParticles=initial_particles_2,
    iFreeParticlesCount=free_particle_count_2,
    iSubiterations=subiterations_2,
    scalePerlin=Slider(0.0107, range=0..0.1),
    iExternalVevtor=division)  # -> out, Particles, FreeParticles, Branches; inputs iReset: Boolean, iInitialParticles: list of Point3d, iFreeParticlesCount: Int32, iSubiterations: Int32, iExternalVevtor: Vector3d
# ---------- ghpython_script_4: Python ----------
import Rhino.Geometry as rg
import Grasshopper.Kernel as gk
import Grasshopper.Kernel.Types as gkt
import random as rd
import math
import rhinoscriptsyntax as rs
import perlin as p

sn=p.SimplexNoise()
boundarySize = 200


class Util:
    def __init__(self):
        pass

    @staticmethod
    def RandomUnitVector():
        # generate a random UnitVector
        # self.lock.acquire()
        theta = 2.0 * math.pi * rd.random()
        phi = math.acos(2.0 * rd.random() - 1.0)
        return rg.Vector3d(math.sin(phi) * math.cos(theta), math.sin(phi) * math.sin(theta), math.cos(phi))
        # self.lock.release()

    @staticmethod
    def RandomUnitVectorUpperHemisphere():
        # self.lock.acquire()
        theta = 2.0 * math.pi * rd.random()
        phi = math.acos(2.0 * rd.random() - 1.0)
        return rg.Vector3d(math.sin(phi) * math.cos(theta), math.sin(phi) * math.sin(theta), abs(math.cos(phi)))
        # self.lock.release()


class FreeParticle:
    def __init__(self, environmentBoundary, particleRadius):
        self.Position = rg.Point3d.Origin + Util.RandomUnitVectorUpperHemisphere() * environmentBoundary
        self.Velocity = Util.RandomUnitVector() * particleRadius


class DlaSystem:
    def __init__(self, initialParticles, freeParticlesCount):
        self.FreeparticlesCount = freeParticlesCount
        self.Particles = initialParticles
        self.ff=FlowField(boundarySize,10,scalePerlin)
        self.Branches = []
        self.clusterReach = 0.0
        self.particleRadius = 5.0
        self.environmentBoundary = 0.0
        for p in self.Particles:
            d = p.DistanceTo(rg.Point3d.Origin)
            if d > self.clusterReach:
                self.clusterReach = d
        self.UpdateEnvironmentBoundary()
        self.FreeParticles = []
        self.fParticle = FreeParticle(self.environmentBoundary, self.particleRadius)
        for i in range(self.FreeparticlesCount):
            self.FreeParticles.append(self.fParticle)
        self.rTree=rg.RTree()
        for i in range (len(self.Particles)):
            self.rTree.Insert(self.Particles[i],i)

    def UpdateEnvironmentBoundary(self):
        self.environmentBoundary = self.clusterReach * 1.0
        if self.environmentBoundary < self.particleRadius * 1.0:
            self.environmentBoundary = self.particleRadius * 1.0

        
    def Iterate(self):
        for i in range(len(self.FreeParticles)):
            freeParticle = self.FreeParticles[i]
            # apply random force to the particle
            v= self.ff.lookUp(freeParticle.Velocity)
            randomForce = Util.RandomUnitVector() * self.particleRadius + v/10  +iExternalVevtor
            freeParticle.Velocity += randomForce

            if freeParticle.Velocity.Length > self.particleRadius:
                freeParticle.Velocity *= self.particleRadius / freeParticle.Velocity.Length
            freeParticle.Position += freeParticle.Velocity#+iExternalVevtor
            self.ProcessBoundary(freeParticle)
            # if the particle wanders out of range, respawn it
            if freeParticle.Position.DistanceTo(rg.Point3d.Origin) > self.environmentBoundary and freeParticle.Position.Z < 0.0:
                self.FreeParticles[i] = FreeParticle(self.environmentBoundary, self.particleRadius)
                continue

            # Otherwise check if the free Particle collide with the cluster
            collidedParticle = rg.Point3d.Unset
            for particle in self.Particles:
                if freeParticle.Position.DistanceTo(particle) <2.0 * self.particleRadius:
                    collidedParticle = particle

            def SearchCallback(sender, args):
                collidedParticle=self.Particles[args.Id]
                args.Cancel=True
            self.rTree.Search(rg.Sphere(freeParticle.Position, 2.0*self.particleRadius), SearchCallback)

            # if a collision has been found
            if collidedParticle.IsValid:
                self.Particles.append(freeParticle.Position)
                #self.Branches.append(rg.Line(freeParticle.Position, collidedParticle))
                self.Branches.append(rg.Line(collidedParticle,freeParticle.Position))
                self.FreeParticles[i] = FreeParticle(self.environmentBoundary, self.particleRadius)
                distanceToOrigin = freeParticle.Position.DistanceTo(rg.Point3d.Origin)
                if self.clusterReach < distanceToOrigin:
                    self.clusterReach = distanceToOrigin

    def ProcessBoundary(self, particle):
        if particle.Position.X<0:
            particle.Position.X=boundarySize
        elif particle.Position.X>boundarySize:
            particle.Position.X=0
        
        if particle.Position.Y<0:
            particle.Position.Y=boundarySize
        elif particle.Position.Y>boundarySize:
            particle.Position.Y=0

        if particle.Position.Z<0:
            particle.Position.Z=boundarySize
        elif particle.Position.Z>boundarySize:
            particle.Position.Z=0
        
        self.UpdateEnvironmentBoundary()


class FlowField:
    def __init__(self, size, res, scalePerlin):
        self.size=size
        self.scaleP=scalePerlin
        self.res=res
        self.pointsPerSide= int(size/res)
        self.grid=self.createGrid()
    def createGrid(self):
        L=[]
        for i in range(self.pointsPerSide):
            L.append([])
            for j in range(self.pointsPerSide):
                L[i].append([])
                for k in range(self.pointsPerSide):
                    L[i][j].append([])
                    point=[i*self.res, j*self.res, k*self.res]
                    perVal= sn.noise3(i*self.scaleP, j*self.scaleP, k*self.scaleP)
                    xVec=[self.res,0,0]
                    rotV=rs.VectorRotate(xVec, 360*perVal, [0,0,1])
                    endV=rs.VectorCreate(point,rotV)
                    L[i][j][k]=rotV
        return L
    def lookUp(self, vec):
        x=int(vec[0]/self.res)
        y=int(vec[1]/self.res)
        z=int(vec[2]/self.res)
        return self.grid[x][y][z]
        
    def drawFirstLayer(self):
        
        layer=[]
        for i in range(self.pointsPerSide):
            for j in range(self.pointsPerSide):
                point=[i*self.res, j*self.res, 0]
                endV=rs.VectorCreate(point,self.lookUp(point))
                layer.append(rs.AddLine(point, endV))
        return layer

# main program

if iReset or "myDlaSystem" not in globals():
    InitialParticles = iInitialParticles
    InitialBranches = []
    FreeParticlesCount = iFreeParticlesCount
    myDlaSystem = DlaSystem(InitialParticles, FreeParticlesCount)


else:
    for i in range(iSubiterations):
        myDlaSystem.Iterate()




Particles = []
for particle in myDlaSystem.Particles:
    Particles.append(gkt.GH_Point(particle))

Branches = []
for line in myDlaSystem.Branches:
    Branches.append(gkt.GH_Line(line))

FreeParticles = []
for freeParticle in myDlaSystem.FreeParticles:
    FreeParticles.append(gkt.GH_Point(freeParticle.Position))
# ---------- end ghpython_script_4 ----------
pt_5 = Point(ghpython_script_4.Particles)
pt_6 = Point(ghpython_script_4.FreeParticles)
line_2 = Line(ghpython_script_4.Branches)

# ----
modetochoose_only_0_and_1_working = ValueList({"GrowOut": 0, "InGrow": 1, "Two": 2, "Three": 3, "Four": 4}, selected="GrowOut")
ghpython_script_5 = GhPythonScript(
    iBrch=line_2,
    iCenter=initial_particles_2,
    iMaxRad=Slider(2, range=0..3),
    iRadShort=Slider(0.23, range=0..1),
    iMode=modetochoose_only_0_and_1_working)  # -> out, oStPt, oEndPt, oVec, oStPl, oEndPl, oDistL1, oDistL2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; inputs iBrch: list of Line, iCenter: Point3d, iMode: Int32
# ---------- ghpython_script_5: Python ----------
__author__ = "GSK"
__version__ = "2021.01.30"

import Rhino.Geometry as rg
import random
import math

#__External_Values_Order__
brchList = iBrch
startingPoint = iCenter
maxRad = iMaxRad
shortening = iRadShort
mode = iMode
#tol = iTolerance
tol = 1.0                 #this is a bad practice to hardcode value but for now it works

#__Empty_Lists_Creation__
stPtList = []
endPtList = []
allPtList = []
vecList = []
stPlList = []
endPlList = []

distList1 = []
distList2 = []

outGeo = []
newGeo = []

def GetBranchInfo(branchList,rootPoint):
    #this method do the heavy lifting and is the main one
    branchTupleList = []
    
    biggestDist = 1.0                       #starting distance to be updated later on
    startPt = rg.Point3d(0,0,0)             #initial values
    endPt = rg.Point3d(0,0,0)
    
    actualSize = rg.Interval(0.0,11.0) # to be updated each time
    #desiredSize = rg.Interval(0.05,1.0) 
    desiredSize = rg.Interval(maxRad*shortening,maxRad)
    
    #__Main_Loop_
    for branch in branchList:
        
        #_Point_creation
        startPt = branch.From
        endPt = branch.To
        
        stPtList.append(startPt)
        endPtList.append(endPt)
        allPtList.append(startPt)
        allPtList.append(endPt)
        #print startPt, endPt
        
        #_DirectionVector_creation
        lineForVector = rg.Line(startPt, endPt)
        DirectionVector = lineForVector.Direction
        vecList.append(DirectionVector)
        
        #_Planes_creation
        stPlane = rg.Plane(startPt, lineForVector.Direction)
        endPlane = rg.Plane(endPt, lineForVector.Direction)
        stPlList.append(stPlane)
        endPlList.append(endPlane)
        
        ##__Distance_Calculation_->_Radius_Calculation
        dist1 = GetDistance(startPt,rootPoint)
        dist2 = GetDistance(endPt,rootPoint)
        #dist1 = startPt.DistanceTo(rootPoint)
        #dist2 = endPt.DistanceTo(rootPoint)
        
        #_size_check___maybe_to_be_moved
        if dist1 > biggestDist:
            biggestDist = dist1
        if dist2 > biggestDist:
            biggestDist = dist2
        actualSize.Grow(biggestDist)        #this should update Interval to include the number
        
        distList1.append(dist1)
        distList2.append(dist2)
        
        ##__Radius_Caluclation
        rad1 = RemapValue(dist1,actualSize,desiredSize,False)
        rad2 = RemapValue(dist2,actualSize,desiredSize,False)
        print rad1, rad2
        
        ##__Working_Part_Geometry_creation
        #tube = GetMeshTube(startPt,endPt,DirectionVector,rad1,rad2)
        tube=getClosedB(startPt,endPt,DirectionVector,rad1,rad2)
        #tube = GetMeshTube(startPt,endPt,DirectionVector,0.6,0.5)
        sphere = GetMeshSphere(endPt,rad2)
        
        outGeo.append(tube)
        outGeo.append(sphere)
        #print outGeo
        
        #_Tuple_creation
        branchTuple =(startPt,endPt,DirectionVector,stPlane,endPlane)
        branchTupleList.append(branchTuple)
        #print branchTuple
    
    newGeo = rg.Brep.CreateBooleanUnion(outGeo, tol)
    return branchTupleList
    

if mode == 0:
    def RemapValue(val, source, target, clip):
        # val is float, source and target Intervals, clip boolean
        value = val 
        sourceMin = source.Min
        sourceMax = source.Max
        targetMin = target.Min
        targetMax = target.Max
        
        if sourceMin==sourceMax:
            remappedVal = (targetMin + targetMax)*0.5
        else:
            remappedVal = targetMin + (targetMax - targetMin) * ((value - sourceMin) / (sourceMax - sourceMin))
        
        if clip == True:
            if val < sourceMin:
                return targetMin
            else:
                if val>sourceMax:
                    return targetMax
                else:
                    return remappedVal
        else:
            return remappedVal
            
        ## proposed usage
        ## oRemappedVal = RemapValue(iVal, iSourceI, iTargetI, iClipped)

elif mode == 1:
    def RemapValue(val, source, target, clip):
        # val is float, source and target Intervals, clip boolean
        value = val 
        sourceMin = source.Max
        sourceMax = source.Min
        targetMin = target.Min
        targetMax = target.Max
        
        if sourceMin==sourceMax:
            remappedVal = (targetMin + targetMax)*0.5
        else:
            remappedVal = targetMin + (targetMax - targetMin) * ((value - sourceMin) / (sourceMax - sourceMin))
        
        if clip == True:
            if val < sourceMin:
                return targetMin
            else:
                if val>sourceMax:
                    return targetMax
                else:
                    return remappedVal
        else:
            return remappedVal
            
        ## proposed usage
        ## oRemappedVal = RemapValue(iVal, iSourceI, iTargetI, iClipped)


#___Geometry_Creation_Scripts___
def GetMeshSphere(position, radius):
    Sphere = rg.Sphere(position,radius)
    SphereBrep = rg.Brep.CreateFromSphere(Sphere)
    #Sphere.ToNurbsSurface()
    
    #Droplet = rg.Mesh.CreateFromSphere(Sphere,4,8)
    #return Droplet
    return SphereBrep

#__Tube_Creation__
"""def BaseCircle(plane,point,radius):
    return rg.Circle(plane,point,radius)"""

def BaseCircle2(plane,radius):
    return rg.ArcCurve(rg.Circle(plane,plane.Origin,radius)) #shortening test

def BaseCircle3(point,vector,radius):
    return rg.ArcCurve(rg.Circle(rg.Plane(point,vector),point,radius)) #different approach

def BaseCircle(plane, radius):
    return rg.ArcCurve(rg.Circle(plane, plane.Origin, radius))
    
def BaseCircle23(point, vector, radius):
    return rg.ArcCurve(rg.Circle(rg.Plane(point,vector), point, radius))
    
    
def getClosedB(stP1, endP1, vector, r1, r2):
    C1= BaseCircle23(stP1, vector, r1)
    C2= BaseCircle23(endP1,vector, r2)
    no_pt=rg.Point3d.Unset
    norm_loft=rg.LoftType.Normal
    breps = rg.Brep.CreateFromLoft([C1,C2],no_pt,no_pt,norm_loft,False)
    m=breps[0]
    return m.CapPlanarHoles(0.01)



#def GetMeshTube(stPt,endPt,stPl,endPl,direction,r1,r2):
def GetMeshTube(stPl,endPl,direction,r1,r2):
    
    CircA = BaseCircle3(stPl,direction,r1)
    CircB = BaseCircle3(endPl,direction,r2)
    
    CircA.ToNurbsCurve()
    CircB.ToNurbsCurve()
    
    crvList = []
    crvList.append(CircA)
    crvList.append(CircB)
    
    caps = rg.Brep.CreatePlanarBreps(crvList)
    
    no_pt=rg.Point3d.Unset
    norm_loft=rg.LoftType.Normal
    breps = rg.Brep.CreateFromLoft([CircA,CircB],no_pt,no_pt,norm_loft,False)
    
    meshOut = breps[0]
    #meshOut.CapPlanarHoles(tol)
    #meshOut.AddSurface(caps[0].)
    #meshOut.AddSurface(caps[1][0])
    #meshOut = rg.Mesh.CreateFromSurface(breps[0])
    #meshOut = rg.Mesh.CreateFromBrep(breps[0])
    #rg.Mesh.CreateFromBrep(breps[0])
    
    return meshOut

def GetDistance(point,root):
    return point.DistanceTo(root)

#__Main
brchInfo = GetBranchInfo(brchList,startingPoint)
#print brchInfo[3][1]

#__Output
#____optional
oStPt = stPtList
oEndPt = endPtList
oVec = vecList
oStPl = stPlList
oEndPl = endPlList
oDistL1 = distList1
oDistL2 = distList2

#___important
oGeometry = outGeo
#oGeometry = GetBranchGeometry(brchInfo)
oGeometry2 = newGeo

#___tests
#oA = BaseCircle(stPlList[1],stPtList[1],5.0)
#oA = BaseCircle2(stPlList[1],5.0)
#oA = BaseCircle3(stPtList[1],vecList[1],5.0)
#oA = GetMeshTube(stPtList[1],endPtList[1],vecList[1],2.0,5.0)
# ---------- end ghpython_script_5 ----------
point_6 = Point(ghpython_script_5.oStPt)
point_7 = Point(ghpython_script_5.oEndPt)
point_8 = Point(ghpython_script_5.oEndPl)
geometry_4 = Geometry(ghpython_script_5.oGeometry)
vector_display_ex_2 = VectorDisplayEx(Point=point_6, Vector=ghpython_script_5.oVec, Colour=RGB(0, 0, 0), Width=2)
mesh = Mesh(geometry_4)
mesh_join = MeshJoin(Meshes=mesh)
